# Requirement set Requirements (R2021a)

## 1 [#1] Doors

### 1.1 [#2] Doors Opening Outside
Once the lift has arrived to the floor called. The system shall open the doors within 10 seconds.

### 1.2 [#4] Door Closing Manual
If the close door button is pressed, the system shall run object detection and close the doors within 5 sec.

### 1.3 [#5] Door Opening Manual
If the open door button is pressed. The system shall ensure the lift is currently at floor destination, and will open the doors.

### 1.4 [#6] Door Closing Automatic
Once the lift has arrived at destined floor, the system shall run object detection

## 2 [#7] Req Floor
The system shall order the floor commands, such that they are either in ascending or descending order

## 3 [#10] Cur Floor

## 4 [#11] Equal
The system shall stop when on the correct floor, when the current floor is equal to the requested floor