# Requirement set Requirements_Simulink_Model (R2021a)

## 1 [#1] Movement of lift

### 1.1 [#2]
system only moves when doors are fully closed

### 1.2 [#3] Moving Up

#### 1.2.1 [#6]
system moves up if button pressed is higher than current floor value

#### 1.2.2 [#7]
system moves up if called externally from a higher floor

### 1.3 [#4] Moving Down

#### 1.3.1 [#8]
system moves down if button pressed is lower than current floor value

#### 1.3.2 [#9]
system moves down if called externally from a lower floor

### 1.4 [#5] Idle

#### 1.4.1 [#10]
system is idle if there is no input/backlog

## 2 [#11] Operation Of Doors

### 2.1 [#12] Opening doors

#### 2.1.1 [#17]
system only opens doors when stationary

#### 2.1.2 [#18]
system opens doors automatically in 3 seconds when it has reached the requested floor

#### 2.1.3 [#19]
system opens doors if the ‘open door’ button is pressed and the lift is at a requested floor

### 2.2 [#13] Closing doors

#### 2.2.1 [#20]
system closes doors automatically after 10 seconds of being fully open

#### 2.2.2 [#21]
system takes 3 seconds to close doors

#### 2.2.3 [#22]
system closes doors if the ‘close door’ button is pressed and no objects are detected

### 2.3 [#14] Object detection

#### 2.3.1 [#23]
system keeps doors open if object is detected by the sensors

#### 2.3.2 [#24]
while the doors are closing, system opens doors immediately if an object is detected by the sensors

### 2.4 [#15] Idle

#### 2.4.1 [#25]
system keeps doors closed while in idle state

## 3 [#26] Logic

## 4 [#27] Emergency State

### 4.1 [#28]
system goes into the emergency state when the ‘stop’ button is pressed

### 4.2 [#29]
when in emergency state, system stops the lift’s movement

### 4.3 [#30]
when in emergency state, system plays the audio command

## 5 [#31] Interface

### 5.1 [#32] Interior Interface

#### 5.1.1 [#36]
system has buttons corresponding to floors -1 to 8

#### 5.1.2 [#37]
system has a ‘stop’ button

#### 5.1.3 [#38]
system has a close doors button

#### 5.1.4 [#39]
system has an open doors button

#### 5.1.5 [#40]
system displays the lift’s position

#### 5.1.6 [#41]
system turns on a light to indicate the lift is moving

### 5.2 [#33] Exterior Interface

#### 5.2.1 [#42]
system has an up button on every floor, except on the top floor

#### 5.2.2 [#43]
system has a down button on every floor, except on the bottom floor

#### 5.2.3 [#44] Lift’s movement view

##### 5.2.3.1 [#46]
indicates the current position

##### 5.2.3.2 [#47]
indicates direction of movement

#### 5.2.4 [#45]
system has a light to indicate the request button was pressed

### 5.3 [#34] Audio

#### 5.3.1 [#48] Music

##### 5.3.1.1 [#51]
system continuously plays music inside the lift

#### 5.3.2 [#49] Audio commands

##### 5.3.2.1 [#52]
active when doors are opening

##### 5.3.2.2 [#53]
active when doors are closing

##### 5.3.2.3 [#54]
active when stopping at a floor

#### 5.3.3 [#50] Alarm

##### 5.3.3.1 [#55]
system uses it when in the emergency state/or when doors are open too long

##### 5.3.3.2 [#56]
active when exceeding weight limit

### 5.4 [#35] Buttons

#### 5.4.1 [#57]
each button has braille text on it

#### 5.4.2 [#58]
the buttons use high contrasting colours between background and text

#### 5.4.3 [#59]
the numbered buttons are 50x50mm

#### 5.4.4 [#60]
emergency button has to be bright red with block letters

## 6 [#61] Physical attributes

### 6.1 [#62] Service

#### 6.1.1 [#67]
system should be able to provide a minimum of 40 years of service

#### 6.1.2 [#68]
system should work for 5 years without being serviced

### 6.2 [#63] Capacity

#### 6.2.1 [#69]
system should be able to hold a maximum of 5 passengers / 375kg

#### 6.2.2 [#70]
system alerts if this condition is exceeded

### 6.3 [#64] Travel

#### 6.3.1 [#71]
system should travel at 3m/s at maximum speed

#### 6.3.2 [#72]
system should slow down when approaching the requested floor

### 6.4 [#65] Dimensions

#### 6.4.1 [#73]
the lift car should have dimensions of 1500x2000x2500mm

#### 6.4.2 [#74]
the cabin should have around 2.5m^2 of floor space

#### 6.4.3 [#75]
lift’s entrance has a width of at least 900mm

#### 6.4.4 [#76]
internal button interface begins no further than 900mm above the floor

#### 6.4.5 [#77]
internal button interface ends no further than 1200mm above the floor

#### 6.4.6 [#78]
external call buttons are 1200mm above the ground

### 6.5 [#66] Motor

#### 6.5.1 [#79]
the lift cabin has a mass of 1200kg

#### 6.5.2 [#80]
the motor has to have a peak torque of 3600Nm

#### 6.5.3 [#81]
the voltage input should be

#### 6.5.4 [#82]
the amperage input should be